# Grasshopper definition 0_final facade gh.gh (Grasshopper 1.0.7)
# plug-ins: RhinoCodePluginGH, LunchBox

max_move = Slider(350, range=0..1000)
# input parameters
min_move = Slider(200, range=0..1000)

wall_height = Slider(6000, range=0..10000)
avg_distance_between = Slider(250, range=0..1000)

direction_switch = BooleanToggle(False)
offset_by = Slider(200, range=0..10000)

amplitude = Slider(800, range=0..1000)
d = Slider(1300, range=0..10000)

divide_line_into = Slider(100, range=0..5000)
repel_strength = Slider(800000, range=0..10000000)
door_height = Slider(2000, range=0..10000)
geometry_pipeline = GeometryPipeline(
    GroupByLayer=False,
    GroupByType=False,
    IncludeHidden=True,
    IncludeLocked=True,
    LayerFilter="repel points window",
    NameFilter="*",
    SublayerFiltering=True,
    TypeFilter=1)
geometry_pipeline_2 = GeometryPipeline(
    GroupByLayer=False,
    GroupByType=False,
    IncludeHidden=True,
    IncludeLocked=True,
    LayerFilter="repel points door",
    NameFilter="*",
    SublayerFiltering=True,
    TypeFilter=1)

# ----
# Bake result
# input plan curve
button = Button()
terracotta_thickness = Slider(80, range=0..1000)
plan_curve = Curve(<curve referenced from the Rhino model>)
move_curves_up_value = MoveCurvesUpValue(
    A=wall_height,
    step=avg_distance_between,
    min_move=min_move,
    max_move=max_move,
    wall_height_2=wall_height,
    wall_height_3=wall_height,
    wall_height=wall_height,
    dist_betw=avg_distance_between)  # -> move_value2, num_of_curves
move_z = MoveZ(geometry=plan_curve, factor=move_curves_up_value.move_value2)
panel = Panel(move_curves_up_value.move_value2)
number_of_curves = Panel(move_curves_up_value.num_of_curves)
curves = Geometry(move_z)
offset = Offset(switch=direction_switch, B=offset_by, curve=curves)  # -> a, curve_2
sine_offset = SineOffset(integer=offset.a, curve=curves, curves=curves, z=move_curves_up_value.move_value2, A=amplitude, H=wall_height, d=d)

curves_1 = Curve(flatten(curves))
curves_2 = Curve(flatten(offset.curve_2))
curves_3 = Curve(flatten(sine_offset))

cluster = Cluster(
    door_height=door_height,
    curves=curves_1,
    repel_pts_door=geometry_pipeline_2,
    repel_pts_win=geometry_pipeline,
    num_pts_curve=divide_line_into,
    A=repel_strength)
cluster_2 = Cluster(
    door_height=door_height,
    curves=curves_2,
    repel_pts_door=geometry_pipeline_2,
    repel_pts_win=geometry_pipeline,
    num_pts_curve=divide_line_into,
    A=repel_strength)
cluster_3 = Cluster(
    door_height=door_height,
    curves=curves_3,
    repel_pts_door=geometry_pipeline_2,
    repel_pts_win=geometry_pipeline,
    num_pts_curve=divide_line_into,
    A=repel_strength)

curves_1_2 = Curve(flatten(cluster))
curves_2_2 = Curve(flatten(cluster_2))
curves_3_2 = Curve(flatten(cluster_3))

loft_curves = Script(curve1=curves_1_2, curve2=curves_2_2)  # -> out, a
# ---------- loft_curves: Python ----------
import rhinoscriptsyntax as rs


# Create a list of curves to loft
curves = [curve1, curve2]

# Perform lofting
lofted_surface = rs.AddLoftSrf(curves)

a = lofted_surface
# ---------- end loft_curves ----------
loft_curves_2 = Script(curve1=curves_1_2, curve2=curves_3_2)  # -> out, a
# ---------- loft_curves_2: Python ----------
import rhinoscriptsyntax as rs


# Create a list of curves to loft
curves = [curve1, curve2]

# Perform lofting
lofted_surface = rs.AddLoftSrf(curves, loft_type=2)

a = lofted_surface
# ---------- end loft_curves_2 ----------
surface = Surface(loft_curves.a)
surface_2 = Surface(loft_curves_2.a)
extrude_z = ExtrudeZ(base=surface, factor=avg_distance_between)
extrude_z_2 = ExtrudeZ(base=surface_2, factor=terracotta_thickness)

geometry = Geometry(extrude_z)
geometry_2 = Geometry(extrude_z_2)

merge = Merge(Data1=geometry, Data2=geometry_2)
object_bake = ObjectBake(
    BakeToggle=button,
    GeometryObjects=merge,
    Layer="brick",
    ObjectName="GH_Obj",
    ObjectColor=RGB(255, 255, 255),
    LayerColor=RGB(255, 255, 255))

# ==== cluster MoveCurvesUpValue
wall_height = ClusterInput()
dist_betw = ClusterInput()
script = Script(wall_height=wall_height, dist_betw=dist_betw)  # -> out, num_of_curves
# ---------- script: Python ----------
num_of_curves = int(wall_height / dist_betw) + 1
print(num_of_curves)
# ---------- end script ----------
A = ClusterInput()
step = ClusterInput()
series = Series(A=A, step=step, count=script.num_of_curves)
num_of_curves = ClusterOutput(script.num_of_curves)
min_move = ClusterInput()
max_move = ClusterInput()
wall_height_2 = ClusterInput()
panel = Panel(series)
script_2 = Script(y=series, min_move=min_move, max_move=max_move, wall_height=wall_height_2, num_of_curves=script.num_of_curves)  # -> out, move
# ---------- script_2: Python ----------
l = max_move

e = (max_move - min_move)/((wall_height/2)**2)
print(e)

m = -e * (y**2) + l
m = int(m)

print(m)

move = m
# ---------- end script_2 ----------
wall_height_3 = ClusterInput()
script_3 = Script(move=script_2.move, wall_height=wall_height_3)  # -> out, flatten(move_value2); inputs move: list
# ---------- script_3: Python ----------
move_value1 = []
move_value2 = []

wh = wall_height

n = len(move)
print(n)

for i in range(n):

    m = i + 1
    m_val = 0

    for j in range(m):
        m_val = m_val + move[j]
    
    move_value1.append(m_val)

print(move_value1)

print(move_value1[n-1])
mv = move_value1[n-1]

sub = 0

if mv > wh:
    diff = mv - wh
    sub = int(diff / n)
    for i in range(n):
        move[i] = move[i] - sub


for i in range(n):

    m = i + 1
    m_val = 0

    for j in range(m):
        m_val = m_val + move[j]
    
    move_value2.append(m_val)

move_value2.insert(0, 0)
print(move_value2)
# ---------- end script_3 ----------
panel_2 = Panel(script_2.move)
move_value2 = ClusterOutput(script_3.move_value2)

# ==== cluster MoveZ
factor = ClusterInput()
unit_z = UnitZ(Factor=factor)
geometry = ClusterInput()
move = Move(Geometry=geometry, Motion=unit_z)  # -> Geometry, Transform
geometry_2 = ClusterOutput(move.Geometry)

# ==== cluster Offset
switch = ClusterInput()
B = ClusterInput()
xy_plane = XYPlane(Origin=Point(0, 0, 0))
offset_direction_switch = Script(switch=switch)  # -> out, a
# ---------- offset_direction_switch: Python ----------
a = 0

if switch==True:
    a = 1
else:
    a = -1

print(a)
# ---------- end offset_direction_switch ----------
multiplication = Multiplication(A=offset_direction_switch.a, B=B)
curve = ClusterInput()
a = ClusterOutput(offset_direction_switch.a)
offset_curve = OffsetCurve(Curve=curve, Distance=multiplication, Plane=xy_plane, Corners=1)
curve_2 = ClusterOutput(offset_curve)

# ==== cluster SineOffset
integer = ClusterInput()
curves = ClusterInput()
z = ClusterInput()
A = ClusterInput()
H = ClusterInput()
d = ClusterInput()
integer_2 = Integer(integer)
script = Script(curves=curves, switch=integer_2, z=z, A=A, H=H, d=d)  # -> out; inputs curves: list
# ---------- script: Python ----------
import math

k = 2 * math.pi * (1/H)

O = (-1) * (A) * (math.sin(k*z))

a = switch

O = a * (O + d)

print(O)
O
# ---------- end script ----------
xy_plane = XYPlane(Origin=Point(0, 0, 0))
curve = ClusterInput()
offset_curve = OffsetCurve(Curve=curve, Distance=script, Plane=xy_plane, Corners=1)
curve_2 = ClusterOutput(offset_curve)

# ==== cluster Cluster
door_height = ClusterInput()
repel_pts_win = ClusterInput()
num_pts_curve = ClusterInput()
repel_pts_door = ClusterInput()
A = ClusterInput()
curves = ClusterInput()
ghpython_script = GhPythonScript(
    door_height=door_height,
    curves=curves,
    repel_pts_door=repel_pts_door,
    repel_pts_win=repel_pts_win,
    num_pts_curve=num_pts_curve,
    A=A)  # -> out, a; inputs curves: Curve, repel_pts_door: list of Point3d, repel_pts_win: list of Point3d
# ---------- ghpython_script: Python ----------
import rhinoscriptsyntax as rs
import Rhino.Geometry as rg


#reverse list order of repel points, count how many there are
repel_pts_door.reverse()
num_repel_pts_door = len(repel_pts_door)

repel_pts_win.reverse()
num_repel_pts_win = len(repel_pts_win)


#repel loop for doors
for lp in range(num_repel_pts_door):
    # Input curve
    curve = curves
    
    # Number of divisions
    num_divisions = num_pts_curve - 1
    
    # Divide the curve into points
    points_on_curve = rs.DivideCurve(curve, num_divisions, create_points=True)
    
    # Input point
    input_point = repel_pts_door[lp]
    
    # Initialize an empty list to store distances
    distances = []
    
    # Calculate distances from each point on the curve to the input point
    for point in points_on_curve:
        distance = rs.Distance(point, input_point)
        distances.append(distance)
    
    # Output the distances as an array
    d = distances
    
    # Find the numerically least value in the list
    min_value = min(d)
    print("min distance = " + str(min_value))
    
    # Is the repelling point above or below the points on the curve?
    closest_point_index = d.index(min_value) #index of numerically least value
    cpi = closest_point_index
    
    z_position_bool = True
    z_coor_pr = int(repel_pts_door[lp].Z)
    z_coor_pc = int(points_on_curve[cpi].Z)
    
    if z_coor_pr > z_coor_pc:
        z_position_bool = False
    
    
    # Calculating repel distance
    repel_dist = []
    influence_dist = 5500
    
    for i in range(int(num_pts_curve)):
        d_temp = d[i]
        if d_temp > influence_dist:
            repel_dist.append(0)
        else:
            dh = door_height
            d_temp = (A/(0.00012*d_temp*d_temp))
            
            repel_dist.append(d_temp)
    
    rd = repel_dist
    
    # Move the points up (Z-axis)
    for t in range(int(num_pts_curve)):
        point_to_move = points_on_curve[t]
        r_temp = rd[t]
        moved_point = rs.PointAdd(point_to_move, [0, 0, r_temp])
        points_on_curve[t] = moved_point
    
    # Interpolate points to form a new curve
    interpolated_curve = rs.AddInterpCurve(points_on_curve)
    curves = interpolated_curve


#repel loop for windows
for lp in range(num_repel_pts_win):
    # Input curve
    curve = curves
    
    # Number of divisions
    num_divisions = num_pts_curve - 1
    
    # Divide the curve into points
    points_on_curve = rs.DivideCurve(curve, num_divisions, create_points=True)
    
    # Input point
    input_point = repel_pts_win[lp]
    
    # Initialize an empty list to store distances
    distances = []
    
    # Calculate distances from each point on the curve to the input point
    for point in points_on_curve:
        distance = rs.Distance(point, input_point)
        distances.append(distance)
    
    # Output the distances as an array
    d = distances
    
    # Find the numerically least value in the list
    min_value = min(d)
    print("min distance = " + str(min_value))
    
    # Is the repelling point above or below the points on the curve?
    closest_point_index = d.index(min_value) #index of numerically least value
    cpi = closest_point_index
    
    z_position_bool = True
    z_coor_pr = int(repel_pts_win[lp].Z)
    z_coor_pc = int(points_on_curve[cpi].Z)
    
    if z_coor_pr > z_coor_pc:
        z_position_bool = False
    
    
    # Calculating repel distance
    repel_dist = []
    influence_dist = 2000
    
    for i in range(int(num_pts_curve)):
        d_temp = d[i]
        if d_temp > influence_dist:
            repel_dist.append(0)
        else:
            dh = door_height
            d_temp = (A/(0.001*d_temp*d_temp))
            
            repel_dist.append(d_temp)
    
    rd = repel_dist
    
    # Move the points up (Z-axis)
    for t in range(int(num_pts_curve)):
        point_to_move = points_on_curve[t]
        r_temp = rd[t]
        if not z_position_bool:
            r_temp = -r_temp
        moved_point = rs.PointAdd(point_to_move, [0, 0, r_temp])
        points_on_curve[t] = moved_point
    
    # Interpolate points to form a new curve
    interpolated_curve = rs.AddInterpCurve(points_on_curve)
    curves = interpolated_curve

a = curves
# ---------- end ghpython_script ----------
a = ClusterOutput(ghpython_script.a)

# ==== cluster ExtrudeZ
factor = ClusterInput()
unit_z = UnitZ(Factor=factor)
base = ClusterInput()
extrude = Extrude(Base=base, Direction=unit_z)
extrusion = ClusterOutput(extrude)

# ==== cluster Series
A = ClusterInput()
division = Division(A=A, B="2")
multiplication = Multiplication(A="-1", B=division)
step = ClusterInput()
count = ClusterInput()
series = Series(Start=multiplication, Step=step, Count=count)
series_2 = ClusterOutput(series)
