# Grasshopper definition box cutting and door windows.gh (Grasshopper 1.0.7)
# plug-ins: LunchBox

# cutting box
button = Button()
bottom_curve = Curve(<curve referenced from the Rhino model>)
xy_plane = XYPlane(Origin=Point(0, 0, 0))
offset_curve = OffsetCurve(Curve=bottom_curve, Distance=Slider(2340, range=-10000..10000), Plane=xy_plane, Corners=1)
offset_curve_2 = OffsetCurve(Curve=bottom_curve, Distance=Slider(-3927, range=-10000..10000), Plane=xy_plane, Corners=1)
floor_lvl = Slider(0, range=0..100000)
loft = Loft(
    Curves=[offset_curve, offset_curve_2],
    Options={Adjust=False, Closed=False, LoftEnds=0, LoftSimp=0, LoftType=0, Rebuild=10, Refit=0.01})
sill_lvl = Slider(-1177, range=-5000..10000)
unit_z = UnitZ(Factor=floor_lvl)
move = Move(Geometry=loft, Motion=unit_z)  # -> Geometry, Transform
unit_z_2 = UnitZ(Factor=sill_lvl)
height_h = Slider(6000, range=0..10000)
move_2 = Move(Geometry=move.Geometry, Motion=unit_z_2)  # -> Geometry, Transform
unit_z_3 = UnitZ(Factor=height_h)
extrude = Extrude(Base=move_2.Geometry, Direction=unit_z_3)
object_bake = ObjectBake(
    BakeToggle=button,
    GeometryObjects=extrude,
    Layer="cutting box",
    ObjectName="GH_Obj",
    ObjectColor=RGB(255, 255, 255),
    LayerColor=RGB(255, 255, 255))
